# Dynamo graph HACKATON 5.dyn (Dynamo 2.3.0.5885)

steel_x = IntegerSlider(14, range=0..100 step 1)  # graph input
steel_y = IntegerSlider(14, range=0..100 step 1)  # graph input
code_block = CodeBlock { 2; }
byCoordinates = Point.ByCoordinates(x=steel_x, y=steel_y, z=code_block)

# group: June
steel_area = IntegerSlider(2, range=0..100 step 1)
piping_area = IntegerSlider(3, range=0..100 step 1)
sand_area = DoubleSlider(2.5, range=0..100 step 0.1)
# note: Generate a site (which are going to be out limitants), So that the cubes locate inbetween those ranges.
# note: Define a spot where the elements should be located from a start point with iterations.
# note: Get an itinaration for each month or phase of the project
bricks_area = IntegerSlider(100, range=0..100 step 1)

byLengths = Cuboid.ByLengths(origin=byCoordinates, width=steel_area, length=steel_area, height=steel_area)
piping_x = IntegerSlider(14, range=0..100 step 1)  # graph input; graph output
piping_y = IntegerSlider(14, range=0..100 step 1)  # graph input; graph output
code_block_2 = CodeBlock { 2; }
byCoordinates_2 = Point.ByCoordinates(x=piping_x, y=piping_y, z=code_block_2)
byLengths_2 = Cuboid.ByLengths(origin=byCoordinates_2, width=piping_area, length=piping_area, height=piping_area)
sand_x = IntegerSlider(14, range=0..100 step 1)  # graph input; graph output
sand_y = IntegerSlider(14, range=0..100 step 1)  # graph input; graph output
code_block_3 = CodeBlock { 2; }
byCoordinates_3 = Point.ByCoordinates(x=sand_x, y=sand_y, z=code_block_3)
byLengths_3 = Cuboid.ByLengths(origin=byCoordinates_3, width=sand_area, length=sand_area, height=sand_area)
bricks_x = IntegerSlider(63, range=0..100 step 1)  # graph input
bricks_y = IntegerSlider(44, range=0..100 step 1)  # graph input
code_block_4 = CodeBlock { 30; }
byCoordinates_4 = Point.ByCoordinates(x=bricks_x, y=bricks_y, z=code_block_4)
byLengths_4 = Cuboid.ByLengths(origin=byCoordinates_4, width=bricks_area, length=bricks_area, height=bricks_area)
centroid = Solid.Centroid(solid=byLengths_4)

# group: Next Steps
boolean = BoolSelector(false)
code_block_5 = CodeBlock { null; }
formula = Formula("if(x,y,z)", x=boolean, z=code_block_5)  # unwired: y
categories = Categories("OST_GenericModel")
byGeometry = DirectShape.ByGeometry(geometry=formula, category=categories)

select_model_element = DSModelElementSelection()  # 1 picked in the model
# note: 1-"area: get value from revit"
# 2-"Materials Specs: Obtained from a specified Excel file delivered to the user as an input."
geometry = Element.Geometry(element=select_model_element)

# group: Minimize
doesIntersect = Geometry.DoesIntersect(geometry=geometry, other=byLengths_4)
formula_2 = Formula("if(x,-100,0)", x=doesIntersect)
intersection_a = Watch(formula_2)

code_block_6 = CodeBlock { 0; }
getItemAtIndex = List.GetItemAtIndex(list=intersection_a, index=code_block_6)
intrersection_a = Watch(getItemAtIndex)  # graph output
select_model_element_2 = DSModelElementSelection()  # 1 picked in the model
geometry_2 = Element.Geometry(element=select_model_element_2)

# group: Maximize
doesIntersect_2 = Geometry.DoesIntersect(geometry=geometry, other=geometry_2)

formula_3 = Formula("if(x,-100,0)", x=doesIntersect_2)

# group (continued): Maximize
intersection_b = Watch(formula_3)

code_block_7 = CodeBlock { 0; }
getItemAtIndex_2 = List.GetItemAtIndex(list=intersection_b, index=code_block_7)
intersection_b_2 = Watch(getItemAtIndex_2)  # graph output

# group: Minimize
doesIntersect_3 = Geometry.DoesIntersect(geometry=geometry, other=geometry_2)
formula_4 = Formula("if(x,-100,0)", x=doesIntersect_3)
intersection_c = Watch(formula_4)

code_block_8 = CodeBlock { 0; }
getItemAtIndex_3 = List.GetItemAtIndex(list=intersection_c, index=code_block_8)
intersection_c_2 = Watch(getItemAtIndex_3)  # graph output
distanceTo = Geometry.DistanceTo(geometry=geometry, other=byLengths_4)
watch = Watch(distanceTo)
code_block_9 = CodeBlock { 0; }
getItemAtIndex_4 = List.GetItemAtIndex(list=watch, index=code_block_9)
distancia_cubo_edificio = Watch(getItemAtIndex_4)  # graph output
